# Grasshopper definition Testing_Prediction_gh.gh (Grasshopper 1.0.7)

# ----
# Controls
list = ValueList({"Mirrored": 0, "Not Mirrored": 1}, selected="Not Mirrored")
list_2 = ValueList({"Two Layers": 2, "Three Layers": 3, "Four Layers": 4, "Five Layers": 5}, selected="Four Layers")
_1 = Slider(7, range=1..10)
_2 = Slider(9, range=1..20)
_3 = Slider(5, range=1..10)
_4 = Slider(7, range=1..10)
_5 = Slider(2, range=1..10)

filter = StreamFilter(Gate=list, Stream0=_1, Stream1=_2)
filter_2 = StreamFilter(Gate=list, Stream0=_1, Stream1=_3)
filter_3 = StreamFilter(Gate=list, Stream0=_2, Stream1=_3)
filter_4 = StreamFilter(Gate=list, Stream0=_1, Stream1=_4)
filter_5 = StreamFilter(Gate=list, Stream0=_2, Stream1=_4)
filter_6 = StreamFilter(Gate=list, Stream0=_1, Stream1=_5)

# ----
# 2
# 3
# 4
# 5
cluster = Cluster_6(_1=_1, _2=filter)  # -> geo_3, srf_2
cluster_2 = Cluster_5(_1=_1, _2=_2, _3=filter_2)  # -> crv, srf_2
cluster_3 = Cluster_3(_1=_1, _2=_2, _3=filter_3, _4=filter_4)  # -> crv, srf_2
cluster_4 = Cluster_4(_1=_1, _2=_2, _3=_3, _4=filter_5, _5=filter_6)  # -> crv, srf_2
subtraction = Subtraction(A=list_2, B=2)

# ----
# Outputs
filter_7 = StreamFilter(Gate=subtraction, Stream0=cluster.geo_3, Stream1=cluster_2.crv, Stream2=cluster_3.crv, Stream3=cluster_4.crv)
filter_8 = StreamFilter(Gate=subtraction, Stream0=cluster.srf_2, Stream1=cluster_2.srf_2, Stream2=cluster_3.srf_2, Stream3=cluster_4.srf_2)
crv = Geometry(filter_7)
srf = Surface(filter_8)

# ==== cluster Cluster_3
_1 = ClusterInput()
_2 = ClusterInput()
_3 = ClusterInput()
_4 = ClusterInput()

cir = Circle(Plane=PlaneXY(0, 0, 0), Radius="10")

cluster = Cluster(num="4", geo=cir)
item = ListItem(List=cluster, Index=0, Wrap=False)  # -> Item, Item1, Item2, Item3
cluster_2 = Cluster_2(num=_3, geo=item.Item)
cluster_3 = Cluster_2(num=_2, geo=item.Item1)
cluster_4 = Cluster_2(num=_4, geo=item.Item2)
cluster_5 = Cluster_2(num=_1, geo=item.Item3)
geo = Geometry(cluster_2)
geo_2 = Geometry(cluster_3)
geo_3 = Geometry(cluster_4)
geo_4 = Geometry(cluster_5)
area = Area(Geometry=geo)  # -> Area, Centroid
area_2 = Area(Geometry=geo_2)  # -> Area, Centroid
area_3 = Area(Geometry=geo_3)  # -> Area, Centroid
area_4 = Area(Geometry=geo_4)  # -> Area, Centroid
srf = Surface([geo, geo_2, geo_3, geo_4])
ln = Line(StartPoint=graft(area.Centroid), EndPoint=area_2.Centroid)
ln_2 = Line(StartPoint=graft(area.Centroid), EndPoint=area_3.Centroid)
ln_3 = Line(StartPoint=graft(area_2.Centroid), EndPoint=area_4.Centroid)
geo_5 = Geometry([ln, ln_2, ln_3])
crv = ClusterOutput(geo_5)
srf_2 = ClusterOutput(srf)

# ==== cluster Cluster_4
_1 = ClusterInput()
_2 = ClusterInput()
_3 = ClusterInput()
_4 = ClusterInput()
_5 = ClusterInput()

cir = Circle(Plane=PlaneXY(0, 0, 0), Radius="10")

cluster = Cluster(num="5", geo=cir)
item = ListItem(List=cluster, Index=0, Wrap=False)  # -> Item, Item1, Item2, Item3, Item4
cluster_2 = Cluster_2(num=_3, geo=item.Item)
cluster_3 = Cluster_2(num=_4, geo=item.Item1)
cluster_4 = Cluster_2(num=_5, geo=item.Item2)
cluster_5 = Cluster_2(num=_2, geo=item.Item3)
cluster_6 = Cluster_2(num=_1, geo=item.Item4)
geo = Geometry(cluster_2)
geo_2 = Geometry(cluster_3)
geo_3 = Geometry(cluster_4)
geo_4 = Geometry(cluster_5)
geo_5 = Geometry(cluster_6)
area = Area(Geometry=geo)  # -> Area, Centroid
area_2 = Area(Geometry=geo_2)  # -> Area, Centroid
area_3 = Area(Geometry=geo_3)  # -> Area, Centroid
area_4 = Area(Geometry=geo_4)  # -> Area, Centroid
area_5 = Area(Geometry=geo_5)  # -> Area, Centroid
srf = Surface([geo, geo_2, geo_3, geo_4, geo_5])
ln = Line(StartPoint=graft(area.Centroid), EndPoint=area_2.Centroid)
ln_2 = Line(StartPoint=graft(area_2.Centroid), EndPoint=area_3.Centroid)
ln_3 = Line(StartPoint=graft(area.Centroid), EndPoint=area_4.Centroid)
ln_4 = Line(StartPoint=graft(area_4.Centroid), EndPoint=area_5.Centroid)
geo_6 = Geometry([ln, ln_2, ln_3, ln_4])
crv = ClusterOutput(geo_6)
srf_2 = ClusterOutput(srf)

# ==== cluster Cluster_5
_1 = ClusterInput()
_2 = ClusterInput()
_3 = ClusterInput()

cir = Circle(Plane=PlaneXY(0, 0, 0), Radius="10")

cluster = Cluster(num="3", geo=cir)
item = ListItem(List=cluster, Index=0, Wrap=False)  # -> Item, Item1, Item2
cluster_2 = Cluster_2(num=_2, geo=item.Item)
cluster_3 = Cluster_2(num=_3, geo=item.Item1)
cluster_4 = Cluster_2(num=_1, geo=item.Item2)
geo = Geometry(cluster_2)
geo_2 = Geometry(cluster_3)
geo_3 = Geometry(cluster_4)
area = Area(Geometry=geo)  # -> Area, Centroid
area_2 = Area(Geometry=geo_2)  # -> Area, Centroid
area_3 = Area(Geometry=geo_3)  # -> Area, Centroid
ln = Line(StartPoint=graft(area.Centroid), EndPoint=area_2.Centroid)
ln_2 = Line(StartPoint=graft(area.Centroid), EndPoint=area_3.Centroid)
srf = Surface([geo, geo_2, geo_3])
geo_4 = Geometry([ln, ln_2])
crv = ClusterOutput(geo_4)
srf_2 = ClusterOutput(srf)

# ==== cluster Cluster_6
_1 = ClusterInput()
_2 = ClusterInput()

cir = Circle(Plane=PlaneXY(0, 0, 0), Radius="10")

cluster = Cluster(num="2", geo=cir)
item = ListItem(List=cluster, Index=0, Wrap=False)  # -> Item, Item1
cluster_2 = Cluster_2(num=_2, geo=item.Item)
cluster_3 = Cluster_2(num=_1, geo=item.Item1)
geo = Geometry(cluster_3)
geo_2 = Geometry(cluster_2)
area = Area(Geometry=geo_2)  # -> Area, Centroid
area_2 = Area(Geometry=geo)  # -> Area, Centroid
ln = Line(StartPoint=graft(area.Centroid), EndPoint=area_2.Centroid)
relay = Relay([geo, geo_2])
srf = Surface(relay)
crv = Geometry(ln)
geo_3 = ClusterOutput(crv)
srf_2 = ClusterOutput(srf)

# ==== cluster Cluster
num = ClusterInput()
geo = ClusterInput()
subtraction = Subtraction(A=num, B=2)
division = Division(A=subtraction, B=2)
division_2 = Division(A="90", B=2)
X = UnitX(Factor=division_2)
neg = Negative(Value=X)
series = Series(Start="90", Step="90", Count=division)
move = Move(Geometry=geo, Motion=X)  # -> Geometry, Transform
move_2 = Move(Geometry=geo, Motion=neg)  # -> Geometry, Transform
X_2 = UnitX(Factor=series)
expression = Expression(x=num, Expression="x % 2 = 0")
rev = Reverse(Vector=X_2)
move_3 = Move(Geometry=geo, Motion=X_2)  # -> Geometry, Transform
move_4 = Move(Geometry=geo, Motion=rev)  # -> Geometry, Transform
move_5 = Move(Geometry=move.Geometry, Motion=X_2)  # -> Geometry, Transform
move_6 = Move(Geometry=move_2.Geometry, Motion=rev)  # -> Geometry, Transform
geo_2 = Geometry([move.Geometry, move_2.Geometry])
filter = StreamFilter(Gate=expression, Stream0=[move_3.Geometry, move_4.Geometry, geo], Stream1=[move_5.Geometry, move_6.Geometry, geo_2])  # -> flatten(Stream)
geo_3 = ClusterOutput(filter)

# ==== cluster Cluster_2
num = ClusterInput()
geo = ClusterInput()
subtraction = Subtraction(A=num, B=2)
division = Division(A=subtraction, B=2)
division_2 = Division(A="30", B=2)
Y = UnitY(Factor=division_2)
neg = Negative(Value=Y)
series = Series(Start="30", Step="30", Count=division)
move = Move(Geometry=geo, Motion=Y)  # -> Geometry, Transform
move_2 = Move(Geometry=geo, Motion=neg)  # -> Geometry, Transform
Y_2 = UnitY(Factor=series)
rev = Reverse(Vector=Y_2)
expression = Expression(x=num, Expression="x % 2 = 0")
move_3 = Move(Geometry=geo, Motion=Y_2)  # -> Geometry, Transform
move_4 = Move(Geometry=geo, Motion=rev)  # -> Geometry, Transform
move_5 = Move(Geometry=move.Geometry, Motion=Y_2)  # -> Geometry, Transform
move_6 = Move(Geometry=move_2.Geometry, Motion=rev)  # -> Geometry, Transform
geo_2 = Geometry([move.Geometry, move_2.Geometry])
filter = StreamFilter(Gate=expression, Stream0=[move_3.Geometry, move_4.Geometry, geo], Stream1=[move_5.Geometry, move_6.Geometry, geo_2])  # -> flatten(Stream)
geo_3 = ClusterOutput(filter)
